# Grasshopper definition grasshopper_demo.gh (Grasshopper 1.0.8)
# plug-ins: RhinoCodePluginGH

panel = Panel("a traditional japanese house in a green garden. House is deep blue.")
panel_2 = Panel("ugly, deformed, disfigured, poor details, bad anatomy, background")
send_request = Button()
image = ImageSampler(
    FilePath="C:\Users\hfuat\Documents\rhino_projects\text2image_test\gen_img_t2i.jpg",
    Filter="Colour",
    Interpolate=False,
    Umax=1,
    Umin=0,
    Vmax=1,
    Vmin=0,
    Wrap=1)
# Text to Image
text2img = Python3Script(
    send=send_request,
    prompt=panel,
    negative_prompt=panel_2,
    num_inference_steps=Slider(50, range=10..100),
    guidance_scale=Slider(7.5, range=0..10))  # -> out, img_base64_data
# ---------- text2img: Python ----------
import base64
import json
from urllib import request

img_base64_data = 'nothing yet!'

def send_request():
    # Prepare the data to be sent
    data = {
        #'prompt': 'sketch portrait of a car speeding on the highway, image contains only one car and it is white',
        'prompt': prompt,
        'negative_prompt': negative_prompt,
        'num_inference_steps': num_inference_steps,
        'guidance_scale': guidance_scale,
    }

    data = json.dumps(data).encode('utf-8')

    # send request to server
    # LOCAL
    URL = 'http://localhost:8000/t2i'
    # REMOTE (VPN)
    #URL = 'http://IP.OF.THE.SERVER:8000/t2i'
    req = request.Request(URL, data=data, headers={'Content-Type': 'application/json'})
    response = request.urlopen(req)

    # decode received image
    response_data = json.loads(response.read().decode('utf-8'))
    generated_image_data = response_data['generated_image']


    save_path = '/path/to/save/folder'
    with open(save_path+'gen_img_t2i.jpg', 'wb') as image_file:
        image_file.write(base64.b64decode(generated_image_data, validate=True))


    img_base64_data = generated_image_data[:100]

if send:
    send_request()
# ---------- end text2img ----------
panel_3 = Panel(text2img.out)
# NOTE: The Python components use a local
# directory to save files.
# 
# Set "save_path" in both Python components.
# 
# Also, if server is running on a remote machine
# set its "URL"
panel_4 = Panel(text2img.img_base64_data)
panel_5 = Panel("ugly, deformed, disfigured, poor details, bad anatomy, background")
image_2 = ImageSampler(
    FilePath="C:\Users\hfuat\Documents\rhino_projects\text2image_test\gen_img_t2i.jpg",
    Filter="Colour",
    Interpolate=False,
    Umax=1,
    Umin=0,
    Vmax=1,
    Vmin=0,
    Wrap=1)
send_request_2 = Button()
# Image to Image
image2image = Python3Script(
    send=send_request_2,
    prompt="cyberpunk building with neon lights, night, clear sky, 8k",
    negative_prompt=panel_5,
    num_inference_steps=Slider(25, range=10..100),
    guidance_scale=Slider(7.5, range=0..10),
    strength=Slider(0.8, range=0.1..1))  # -> out, img_base64_data
# ---------- image2image: Python ----------
import base64
import json
from urllib import request

img_base64_data = 'nothing yet!'


def read_and_encode_img(img_url):
    # encode image for sending over API
    with open(img_url, 'rb') as image_file:
        encoded_image = base64.b64encode(image_file.read()).decode('utf-8')
    return encoded_image


def send_request():
    # Read image data from files
    IMG_URL = 'C:/Users/hfuat/Documents/rhino_projects/text2image_test/gen_img_t2i.jpg'

    encoded_img = read_and_encode_img(IMG_URL)

    # Prepare the data to be sent
    data = {
        'image': encoded_img,
        'prompt': prompt,
        'negative_prompt': negative_prompt,
        'num_inference_steps': num_inference_steps,
        'guidance_scale':guidance_scale,
        'strength': strength,
    }

    data = json.dumps(data).encode('utf-8')

    # send request to server
    # LOCAL
    URL = 'http://localhost:8000/i2i'
    # REMOTE (VPN)
    #URL = 'http://IP.OF.THE.SERVER:8000/i2i'
    req = request.Request(URL, data=data, headers={'Content-Type': 'application/json'})
    response = request.urlopen(req)

    # decode received image
    response_data = json.loads(response.read().decode('utf-8'))
    generated_image_data = response_data['generated_image']


    save_path = '/path/to/save/folder'
    with open(save_path+'gen_img_i2i.jpg', 'wb') as image_file:
        image_file.write(base64.b64decode(generated_image_data, validate=True))


    img_base64_data = generated_image_data[:100]

if send:
    send_request()

print(send)
# ---------- end image2image ----------
image_3 = ImageSampler(
    FilePath="C:\Users\hfuat\Documents\rhino_projects\text2image_test\gen_img_i2i.jpg",
    Filter="Colour",
    Interpolate=False,
    Umax=1,
    Umin=0,
    Vmax=1,
    Vmin=0,
    Wrap=1)
panel_6 = Panel(image2image.out)
panel_7 = Panel(image2image.img_base64_data)
